# Dynamo graph 1 - Extração de quantitativos.dyn (Dynamo 3.3.0.6316)

file_path = Filename(".\EAP.xlsx")
string = StringInput("EAP")
code_block = CodeBlock { 0; }
code_block_2 = CodeBlock { 5; }
categories = Categories("OST_StructuralFoundation")
all_elements_of_category = ElementsOfCategory(Category=categories)
categories_2 = Categories("OST_Walls")
all_elements_of_category_2 = ElementsOfCategory(Category=categories_2)
categories_3 = Categories("OST_StructuralColumns")
all_elements_of_category_3 = ElementsOfCategory(Category=categories_3)
categories_4 = Categories("OST_StructuralFraming")
all_elements_of_category_4 = ElementsOfCategory(Category=categories_4)
categories_5 = Categories("OST_Floors")
all_elements_of_category_5 = ElementsOfCategory(Category=categories_5)
categories_6 = Categories("OST_StairsRuns")
all_elements_of_category_6 = ElementsOfCategory(Category=categories_6)
categories_7 = Categories("OST_StairsLandings")
all_elements_of_category_7 = ElementsOfCategory(Category=categories_7)
join = List.Join(list0=all_elements_of_category, list1=all_elements_of_category_2, list2=all_elements_of_category_3, list3=all_elements_of_category_4, list4=all_elements_of_category_5, list5=all_elements_of_category_6, list6=all_elements_of_category_7)
string_2 = StringInput("Volume")
getParameterValueByName = Element.GetParameterValueByName(element=join, parameterName=string_2)
count = List.Count(list=getParameterValueByName)
geometry = Element.Geometry(element=all_elements_of_category_6)
volume = Solid.Volume(solid=geometry)
count_2 = List.Count(list=volume)
geometry_2 = Element.Geometry(element=all_elements_of_category_7)
volume_2 = Solid.Volume(solid=geometry_2)
count_3 = List.Count(list=volume_2)
code_block_3 = CodeBlock(total=count, lances=count_2, patamar=count_3) { total-(lances+patamar); }
takeItems = List.TakeItems(list=getParameterValueByName, amount=code_block_3)
join_2 = List.Join(list0=volume, list1=volume_2)
flatten = List.Flatten(list=join_2)
join_3 = List.Join(list0=takeItems, list1=flatten)
string_3 = StringInput("Marca")
getParameterValueByName_2 = Element.GetParameterValueByName(element=join, parameterName=string_3)
groupByKey = List.GroupByKey(list=join_3, keys=getParameterValueByName_2)
sortByKey = List.SortByKey(list=groupByKey.groups, keys=groupByKey.uniqueKeys)
sum = Math.Sum(values=sortByKey.sortedList@L2)
code_block_4 = CodeBlock { 1; }
chop = List.Chop(list=sum, lengths=code_block_4)
code_block_5 = CodeBlock { 0; }
string_4 = StringInput("Comprimento total")
getParameterValueByName_3 = Element.GetParameterValueByName(element=all_elements_of_category, parameterName=string_4)
python_script = Python(IN[0]=getParameterValueByName_3)  # PythonNet3
# ---------- python_script.python (5 lines) ----------
# Carregar as bibliotecas DesignScript e padrão do Python
import sys
import clr

OUT = [isinstance(x, (int, float)) for x in IN[0]]
# ----------------------------------------
filterByBoolMask = List.FilterByBoolMask(list=getParameterValueByName_3, mask=python_script)
code_block_6 = CodeBlock(x=filterByBoolMask.in) { x == 15; }
filterByBoolMask_2 = List.FilterByBoolMask(list=filterByBoolMask.in, mask=code_block_6)
sum_2 = Math.Sum(values=filterByBoolMask_2.out)
replaceItemAtIndex = List.ReplaceItemAtIndex(list=chop, index=code_block_5, item=sum_2@L2)
code_block_7 = CodeBlock { 1; }
flatten_2 = List.Flatten(list=replaceItemAtIndex, amount=code_block_7)
sum_3 = Math.Sum(values=filterByBoolMask_2.in)
replaceItemAtIndex_2 = List.ReplaceItemAtIndex(list=flatten_2, index=code_block_7, item=sum_3@L2)
flatten_3 = List.Flatten(list=replaceItemAtIndex_2, amount=code_block_7)
boolean = BoolSelector(false)
exportToExcel = Data.ExportToExcel(filePath=file_path, sheetName=string, startRow=code_block, startColumn=code_block_2, data=flatten_3, overWrite=boolean, writeAsString=boolean)
