# Dynamo graph 2 - Estimativa de duração.dyn (Dynamo 3.3.0.6316)

string = StringInput("DIGITAR CAMINHO COMPLETO DO ARQUIVO AQUI")
string_2 = StringInput("EAP")
code_block = CodeBlock { 0; }
code_block_2 = CodeBlock { 6; }
file_from_path = FileObject(path=string)
boolean = BoolSelector(false)
importExcel = Data.ImportExcel(file=file_from_path, sheetName=string_2, readAsStrings=boolean, showExcel=boolean)
transpose = List.Transpose(lists=importExcel)
code_block_3 = CodeBlock { 5; }
getItemAtIndex = List.GetItemAtIndex(list=transpose, index=code_block_3)
transpose_2 = List.Transpose(lists=importExcel)
code_block_4 = CodeBlock { 3; }
getItemAtIndex_2 = List.GetItemAtIndex(list=transpose_2, index=code_block_4)
div = getItemAtIndex / getItemAtIndex_2
code_block_5 = CodeBlock { 9; }
div_2 = div / code_block_5
ceiling = Math.Ceiling(number=div_2)
boolean_2 = BoolSelector(false)
exportToExcel = Data.ExportToExcel(filePath=string, sheetName=string_2, startRow=code_block, startColumn=code_block_2, data=ceiling, overWrite=boolean_2, writeAsString=boolean_2)
