# Dynamo graph 3 - Montagem do cronograma.dyn "3 - Montagem cronograma" (Dynamo 3.3.0.6316)

string = StringInput("CAMINHO COMPLETO DO ARQUIVO EXCEL AQUI")
string_2 = StringInput("EAP")
code_block = CodeBlock { 0; }
code_block_2 = CodeBlock { 7; }
code_block_3 = CodeBlock { 2026; }
code_block_4 = CodeBlock { 01; }
byDate = DateTime.ByDate(year=code_block_3, month=code_block_4, day=code_block_4)
file_from_path = FileObject(path=string)
string_3 = StringInput("EAP")
boolean = BoolSelector(false)
importExcel = Data.ImportExcel(file=file_from_path, sheetName=string_3, readAsStrings=boolean, showExcel=boolean)
transpose = List.Transpose(lists=importExcel)
code_block_5 = CodeBlock { 6; }
getItemAtIndex = List.GetItemAtIndex(list=transpose, index=code_block_5)
python_script = Python(IN[0]=byDate, IN[1]=getItemAtIndex)  # PythonNet3
# ---------- python_script.python (50 lines) ----------
# Carregar as bibliotecas DesignScript e padrão do Python
import sys
import clr
import datetime
# ---------- ENTRADAS ----------
# IN[0] = data inicial do Dynamo (DateTime.ByDate)
# IN[1] = lista de durações em dias úteis (ex: [5,3,7])

data_inicial = IN[0]
duracoes = IN[1]

# converter data inicial para datetime do Python
data_atual = datetime.datetime(data_inicial.Year, data_inicial.Month, data_inicial.Day)

# ---------- FUNÇÃO AUXILIAR ----------
def adicionar_dias_uteis(data, dias):
    """
    Soma 'dias' dias úteis a 'data', incluindo o próprio dia inicial como dia 1
    """
    contador = 1  # conta o próprio dia inicial
    data_fim = data
    while contador < dias:
        data_fim += datetime.timedelta(days=1)
        if data_fim.weekday() < 5:  # segunda=0 ... sexta=4
            contador += 1
    return data_fim

# ---------- LISTAS DE SAÍDA ----------
lista_inicio = []
lista_fim = []

for duracao in duracoes:
    # data de início do serviço = data atual
    lista_inicio.append(data_atual)
    
    # data final do serviço = data de início + duração (dias úteis)
    data_final = adicionar_dias_uteis(data_atual, duracao)
    lista_fim.append(data_final)
    
    # próxima data de início = próximo dia útil após data_final
    proximo_inicio = data_final + datetime.timedelta(days=1)
    while proximo_inicio.weekday() >= 5:  # pular fim de semana
        proximo_inicio += datetime.timedelta(days=1)
    data_atual = proximo_inicio

# ---------- FORMATAÇÃO DD/MM/AAAA ----------
lista_inicio_fmt = [d.strftime("%d/%m/%Y") for d in lista_inicio]
lista_fim_fmt = [d.strftime("%d/%m/%Y") for d in lista_fim]

OUT = (lista_inicio_fmt, lista_fim_fmt)
# ----------------------------------------
transpose_2 = List.Transpose(lists=python_script)
boolean_2 = BoolSelector(false)
boolean_3 = BoolSelector(true)
exportToExcel = Data.ExportToExcel(filePath=string, sheetName=string_2, startRow=code_block, startColumn=code_block_2, data=transpose_2, overWrite=boolean_2, writeAsString=boolean_3)
